# Grasshopper definition 1 - My First Component.gh (Grasshopper 0.9.76)
# plug-ins: Python Interpreter

panel = Panel("Inset the path to python.exe. It can be found in the Anaconda folder.")
python_executor = PythonScript(PythonPath=panel)  # -> readMe
# ---------- python_executor: Python ----------
"""
This component sets the path to the CPython executor.
    
    Args:
        PythonPath: Path to python.exe.
    Returns:
        readMe!: In case of any errors, it will be shown here..
"""

#------------------------------------------------------------------------------#
# Imports
import os
import scriptcontext as sc
import Grasshopper.Kernel as gh

#------------------------------------------------------------------------------#
# Functions

def check_inputs(py_exe):
    """
    Checks inputs and raises a warning if an input is not the correct type.
    """
    
    if py_exe:
        if os.path.exists(py_exe):
            return True
        else:
            warning = 'Component can not find Python'
            print(warning)
            w = gh.GH_RuntimeMessageLevel.Warning
            ghenv.Component.AddRuntimeMessage(w, warning)

def main(py_exe):
    """
    In case all the checks have passed the component runs.
    It prints the python.exe path and creates a scriptcontext.sticky with the path.
    """

    if check_inputs(py_exe):
        print('Python Executor is set to: ' + py_exe)
        sc.sticky['PythonExe'] = py_exe

#------------------------------------------------------------------------------#
# Execution

main(PythonPath)
# ---------- end python_executor ----------
panel_2 = Panel(python_executor)
