# Grasshopper definition 1b - My First Componen_completed.gh (Grasshopper 0.9.76)
# plug-ins: Python Interpreter

panel = Panel("Inset the path to python.exe. It can be found in the Anaconda folder.")
python_executor = PythonScript(PythonPath=panel)  # -> readMe
# ---------- python_executor: Python ----------
"""
This component sets the path to the CPython executor.
    
    Args:
        PythonPath: Path to python.exe.
    Returns:
        readMe!: In case of any errors, it will be shown here..
"""

#------------------------------------------------------------------------------#
# Imports
import os
import scriptcontext as sc
import Grasshopper.Kernel as gh

#------------------------------------------------------------------------------#
# Functions

def check_inputs(py_exe):
    """
    Checks inputs and raises a warning if an input is not the correct type.
    """
    
    if py_exe:
        if os.path.exists(py_exe):
            return True
        else:
            warning = 'Component can not find Python'
            print(warning)
            w = gh.GH_RuntimeMessageLevel.Warning
            ghenv.Component.AddRuntimeMessage(w, warning)

def main(py_exe):
    """
    In case all the checks have passed the component runs.
    It prints the python.exe path and creates a scriptcontext.sticky with the path.
    """

    if check_inputs(py_exe):
        print('Python Executor is set to: ' + py_exe)
        sc.sticky['PythonExe'] = py_exe

#------------------------------------------------------------------------------#
# Execution

main(PythonPath)
# ---------- end python_executor ----------
panel_2 = Panel(python_executor)
my_first_component = PythonScript(x="Hello World!", y=Slider(2, range=1..10), run=Toggle(False))  # -> out
# ---------- my_first_component: Python ----------
#------------------------------------------------------------------------------#
# Imports
import os
import scriptcontext as sc
import subprocess
import livestock3d

#------------------------------------------------------------------------------#
# Functions

def write_file(file_path, string, number_of_repeats):
    file = open(file_path, 'w')
    file.write(str(string) + '\n')
    file.write(str(int(number_of_repeats)) + '\n')
    file.close()

def write_template(template, path):
    livestock3d.pick_template(template, path)

def run_template(py_exe, template_to_run):
    thread = subprocess.Popen([py_exe, template_to_run])
    thread.wait()
    thread.kill()
    
def load_file(file):
    file = open(file, 'r')
    lines = file.readlines()
    file.close()
    
    return lines

def print_lines(lines):
    for line in lines:
        print(line.strip())
        
        
#------------------------------------------------------------------------------#
# Execution

# Get CPython path from the other component
py = str(sc.sticky["PythonExe"])

# Make folder
folder = r'C:/livestock3d/data'
if not os.path.exists(folder):
    os.mkdir(folder)

# Specify paths 
txt_file = folder + '/data_file.txt'
template_file = folder + '/my_first_template.py'
result_file = folder + '/result.txt'

# Run functions
if run:
    write_file(txt_file, x, y)
    write_template('my_first_template', folder)
    run_template(py, template_file)
    data = load_file(result_file)
    print_lines(data)
# ---------- end my_first_component ----------
panel_3 = Panel(my_first_component)
