# Grasshopper definition 2 - Plot Graph.gh (Grasshopper 0.9.76)
# plug-ins: Python Interpreter, Ironbug

panel = Panel("Inset the path to python.exe. It can be found in the Anaconda folder.")
python_executor = PythonScript(PythonPath=panel)  # -> readMe
# ---------- python_executor: Python ----------
"""
This component sets the path to the CPython executor.
    
    Args:
        PythonPath: Path to python.exe.
    Returns:
        readMe!: In case of any errors, it will be shown here..
"""

#------------------------------------------------------------------------------#
# Imports
import os
import scriptcontext as sc
import Grasshopper.Kernel as gh

#------------------------------------------------------------------------------#
# Functions

def check_inputs(py_exe):
    """
    Checks inputs and raises a warning if an input is not the correct type.
    """
    
    if py_exe:
        if os.path.exists(py_exe):
            return True
        else:
            warning = 'Component can not find Python'
            print(warning)
            w = gh.GH_RuntimeMessageLevel.Warning
            ghenv.Component.AddRuntimeMessage(w, warning)

def main(py_exe):
    """
    In case all the checks have passed the component runs.
    It prints the python.exe path and creates a scriptcontext.sticky with the path.
    """

    if check_inputs(py_exe):
        print('Python Executor is set to: ' + py_exe)
        sc.sticky['PythonExe'] = py_exe

#------------------------------------------------------------------------------#
# Execution

main(PythonPath)
# ---------- end python_executor ----------
series = Series(Start=Slider(0, range=-10..10), Step=1, Count=Slider(20, range=0..100))
expression = Expression(x=series, Expression="2*x² - 40*x")
panel_2 = Panel(python_executor)
plotter = PythonScript(x=expression, run=Toggle(False))  # -> out, result_file; inputs x: list
# ---------- plotter: Python ----------
#------------------------------------------------------------------------------#
# Imports
import os
import scriptcontext as sc
import subprocess
import livestock3d

#------------------------------------------------------------------------------#
# Functions

def write_file(file_path, x):
    file = open(file_path, 'w')
    
    for value in x:
        file.write(str(value) + '\n')

    file.close()

def write_template(template, path):
    livestock3d.pick_template(template, path)

def run_template(py_exe, template_to_run):
    thread = subprocess.Popen([py_exe, template_to_run])
    thread.wait()
    thread.kill()
    
def load_file(file):
    file = open(file, 'r')
    lines = file.readlines()
    file.close()
    
    return lines

def print_lines(lines):
    for line in lines:
        print(line.strip())
        
        
#------------------------------------------------------------------------------#
# Execution

# Get CPython path from the other component
py = str(sc.sticky["PythonExe"])

# Make folder
folder = r'C:/livestock3d/data'
if not os.path.exists(folder):
    os.mkdir(folder)

# Specify paths 
txt_file = folder + '/data_file.txt'
template_file = folder + '/plot_graph_template.py'
result_file = folder + '/plot.png'

# Run functions
if run:
    write_file(txt_file, x)
    write_template('plot_graph', folder)
    run_template(py, template_file)
# ---------- end plotter ----------
viewer = Ladybug_ImageViewer(ImagePath_=plotter.result_file, _scale_=1, DisableClickable=False, SaveImgWithCoords=False, scale=1)  # -> ImagePath, Colors, GIF
