# Grasshopper definition 3b - SSH Plot Graph_completed.gh (Grasshopper 0.9.76)
# plug-ins: Python Interpreter, Ironbug

panel = Panel("Inset the path to python.exe. It can be found in the Anaconda folder.")
python_executor = PythonScript(PythonPath=panel)  # -> readMe
# ---------- python_executor: Python ----------
__author__ = "Christian Kongsgaard"
__license__ = "MIT"

"""
This component sets the path to the CPython executor.
    
    Args:
        PythonPath: Path to python.exe.
    Returns:
        readMe!: In case of any errors, it will be shown here..
"""

#------------------------------------------------------------------------------#
# Imports
import os
import scriptcontext as sc
import Grasshopper.Kernel as gh

#------------------------------------------------------------------------------#
# Functions

def check_inputs(py_exe):
    """
    Checks inputs and raises a warning if an input is not the correct type.
    """
    
    if py_exe:
        if os.path.exists(py_exe):
            return True
        else:
            warning = 'Component can not find Python'
            print(warning)
            w = gh.GH_RuntimeMessageLevel.Warning
            ghenv.Component.AddRuntimeMessage(w, warning)

def main(py_exe):
    """
    In case all the checks have passed the component runs.
    It prints the python.exe path and creates a scriptcontext.sticky with the path.
    """

    if check_inputs(py_exe):
        print('Python Executor is set to: ' + py_exe)
        sc.sticky['PythonExe'] = py_exe

#------------------------------------------------------------------------------#
# Execution

main(PythonPath)
# ---------- end python_executor ----------
ssh_connection = PythonScript(IP="127.0.0.1", Port="22")  # -> out
# ---------- ssh_connection: Python ----------
__author__ = "Christian Kongsgaard"
__license__ = "MIT"

"""
A component that handles the SSH configuration.
    
    Args:
        IP: IP Address for SSH connection
        Port: Port for SSH connection
        Username: Username for SSH connection
        Password: Password for SSH connection
    Returns:
        readMe!: In case of any errors, it will be shown here..
"""

#------------------------------------------------------------------------------#
# Imports
import os
import scriptcontext as sc

#------------------------------------------------------------------------------#
# Functions

def run():
    """
    In case all the checks have passed the component runs.
    It prints out the IP, Port and Username and creates a
    scriptcontext.sticky all four inputs.
    """

    print('SSH connection is set to:'
          '\nIP: ' + str(IP) +
          '\nPort: ' + str(Port) +
          '\nUser: ' + str(Username))
    print('')
    print('Open Bash and run:'
          '\nsudo service ssh --full-restart')

    sc.sticky['SSH'] = {'ip': IP, 'port': Port, 'user': Username, 'password': Password}

#------------------------------------------------------------------------------#
# Execution

run()
# ---------- end ssh_connection ----------
series = Series(Start=Slider(0, range=-10..10), Step=1, Count=Slider(20, range=0..100))
panel_2 = Panel(ssh_connection)
expression = Expression(x=series, Expression="2*x² - 40*x")
panel_3 = Panel(python_executor)
ssh_plotter = PythonScript(x=expression, run=Toggle(False))  # -> out, result_file; inputs x: list
# ---------- ssh_plotter: Python ----------
__author__ = "Christian Kongsgaard"
__license__ = "MIT"

#------------------------------------------------------------------------------#
# Imports
import os
import scriptcontext as sc
import subprocess
import livestock3d

#------------------------------------------------------------------------------#
# Functions

def write_file(file_path, x):
    file = open(file_path, 'w')
    
    for value in x:
        file.write(str(value) + '\n')

    file.close()

def write_ssh_files():
    # Clean SSH folder
    livestock3d.clean_ssh_folder()

    # SSH commands
    ssh_command = livestock3d.get_ssh()

    file_transfer = ['in_data.txt', 'plot_graph_template.py', 'data_file.txt']

    ssh_command['file_transfer'] = ','.join(file_transfer)
    ssh_command['file_run'] = 'plot_graph_template.py'
    ssh_command['file_return'] = 'plot.png'
    ssh_command['template'] = 'plot_graph'

    livestock3d.write_ssh_commands(ssh_command)

    return ssh_command
            
            
def run_template(py_exe, template_to_run):
    thread = subprocess.Popen([py_exe, template_to_run])
    thread.wait()
    thread.kill()
    
def load_file(file):
    file = open(file, 'r')
    lines = file.readlines()
    file.close()
    
    return lines

def print_lines(lines):
    for line in lines:
        print(line.strip())
        
        
#------------------------------------------------------------------------------#
# Execution

# Get CPython path from the other component
py = str(sc.sticky["PythonExe"])

# Make folder
folder = 'C:/livestock3d/ssh'
if not os.path.exists(folder):
    os.mkdir(folder)

# Specify paths 
txt_file = folder + '/data_file.txt'
template_file = folder + '/ssh_template.py'
result_file = folder + '/plot.png'

# Run functions
if run:
    #write_ssh_files()
    #write_file(txt_file, x)
    run_template(py, template_file)
# ---------- end ssh_plotter ----------
panel_4 = Panel(ssh_plotter.out)
viewer = Ladybug_ImageViewer(ImagePath_=ssh_plotter.result_file, _scale_=1, DisableClickable=False, SaveImgWithCoords=False, scale=1)  # -> ImagePath, Colors, GIF
